# Grasshopper definition DetailedWaterTower.gh (Grasshopper 0.9.76)
# plug-ins: Python Interpreter

leaf_angle = Slider(3.166, range=0..6.283)
stem_radius = Slider(7.4, range=1..20)
tower_height = Slider(180, range=0..300)
elevator_thickness = Slider(2.01, range=0..4)
framing_thickness = Slider(0.22, range=0..1)
leaf_amount = Slider(6, range=1..7)
stem_level_height = Slider(3.5, range=1..5)
level_thickness = Slider(2, range=0..5)
stem_gap_radius = Slider(2.3, range=0..10)
window_amount = Slider(8, range=0..15)
randomise_angle = BooleanToggle(True)
framing_shift = Slider(2, range=0..15)
# Some of these can take quite a while to load if you edit anything, so better not to drag items!
tower_base = Point(Point(-43.28271552, 46.3226775, 0))
randomised_angles = Boolean(randomise_angle)
level_thickness_2 = Data(level_thickness)
window_amount_2 = Data(window_amount)
framing_thickness_2 = Data(framing_thickness)
tower_base_2 = Point(tower_base)
stem_level_height_2 = Data(stem_level_height)
stem_gap_radius_2 = Data(stem_gap_radius)
elevator_thickness_2 = Data(elevator_thickness)
stem_radius_2 = Data(stem_radius)
tower_height_2 = Data(tower_height)
leaf_amount_2 = Data(leaf_amount)
leaf_angle_2 = Data(leaf_angle)
framing_shift_2 = Data(framing_shift)
Z = UnitZ(Factor=tower_height_2)
avr = Average(Input=leaf_angle_2)
move = Move(Geometry=tower_base_2, Motion=Z)  # -> Geometry, Transform
leaf_base_point = Point(Point(3.896008657, -18.35570401, 0))
range = Range(Domain=Domain(0.1, 1), Steps=expr("x+1", leaf_amount_2))
number_slider = Slider(1, range=0..1)
division = Division(A=tower_height_2, B=stem_level_height_2)
random = Random(Range=Domain(0, 6.283), Number=leaf_amount_2, Seed=avr)
crv = Curve(<curve referenced from the Rhino model>)
ln = Line(StartPoint=tower_base_2, EndPoint=move.Geometry)
round = Round(Number=division)  # -> Nearest, Floor, Ceiling
multiplication = Multiplication(A=random, B=randomised_angles)
split = SplitList(List=range, Index=number_slider)  # -> ListA, ListB
addition = Addition(A=leaf_angle_2, B=multiplication)
range_2 = Range(Domain=Domain(0, 1), Steps=expr("x+1", round.Nearest))
split_2 = SplitList(List=split.ListB, Index=leaf_amount_2)  # -> ListA, ListB
rotate = Rotate(Geometry=crv, Angle=addition, Plane=leaf_base_point)  # -> Geometry, Transform
split_3 = SplitList(List=range_2, Index=number_slider)  # -> ListA, ListB
eval = EvaluateCurve(Curve=ln, Parameter=split_2.ListA)  # -> Point, Tangent, Angle
vec2pt = Vector2Pt(PointA=leaf_base_point, PointB=eval.Point, Unitize=False)  # -> Vector, Length
split_4 = SplitList(List=split_3.ListB, Index=round.Nearest)  # -> ListA, ListB
addition_2 = Addition(A=stem_gap_radius_2, B=elevator_thickness_2)
move_2 = Move(Geometry=rotate.Geometry, Motion=vec2pt.Vector)  # -> Geometry, Transform
eval_2 = EvaluateCurve(Curve=ln, Parameter=split_4.ListA)  # -> Point, Tangent, Angle
cyl = Cylinder(Base=tower_base_2, Radius=stem_gap_radius_2, Length=tower_height_2)
cyl_2 = Cylinder(Base=tower_base_2, Radius=addition_2, Length=tower_height_2)
Z_2 = UnitZ(Factor=level_thickness_2)
boundary = BoundarySurfaces(Edges=move_2.Geometry)
xy = XYPlane(Origin=eval_2.Point)
cyl_3 = Cylinder(Base=tower_base_2, Radius=stem_radius_2, Length=tower_height_2)
xz = XZPlane(Origin=tower_base_2)
yz = YZPlane(Origin=tower_base_2)
cap = CapHoles(Brep=cyl_3)
cap_2 = CapHoles(Brep=cyl_2)
cap_3 = CapHoles(Brep=cyl)
extr = Extrude(Base=boundary, Direction=Z_2)
merge = Merge(Data1=yz, Data2=xz)
sdiff = SolidDifference(BrepsA=cap, BrepsB=cap_2)
sdiff_2 = SolidDifference(BrepsA=cap_2, BrepsB=cap_3)
merge_2 = Merge(Data1=extr, Data2=cyl_3)
pbs = PythonScript(brp=sdiff_2, pln=merge)  # -> pieces; inputs brp: Brep, pln: list of Plane
# ---------- pbs: Python ----------
import rhinoscriptsyntax as rs
import Rhino as rh
import System as sys
import scriptcontext as sc

""" S
Split Brep plane 2012, 
by Arie-Willem de Jongh
"""


arrBrep =[]
arrBrep.append(brp)

if brp and pln:
    
    bb = rh.Geometry.Brep.GetBoundingBox(brp,rh.Geometry.Plane.WorldXY)
    
    for i in pln:
        bool,extU,extV = rh.Geometry.Plane.ExtendThroughBox(i,bb)
        extU.T0 = extU.T0 - 1
        extU.T1 = extU.T1 + 1
        extV.T0 = extV.T0 - 1
        extV.T1 = extV.T1 + 1
        
        planeSrf = rh.Geometry.PlaneSurface(i,extU,extV)
        splitter = planeSrf.ToBrep()
        arrBrepC = arrBrep[:]
        for j in arrBrepC:
            brep = rs.coercebrep(j)
            tbrep = brep.Split(splitter,0.001)
            if tbrep:
                arrBrep.remove(j)
                for k in tbrep:
                    h=k.CapPlanarHoles(0.001)
                    if h:
                        arrBrep.append(h)
                    else:
                        arrBrep.append(k)

pieces = arrBrep
# ---------- end pbs ----------
tower = Brep(merge_2)
debrep = DeconstructBrep(Brep=cyl_3)  # -> Faces, Edges, Vertices
data = Data(pbs)
pbs_2 = PythonScript(brp=sdiff, pln=xy)  # -> flatten(pieces); inputs brp: Brep, pln: list of Plane; same code as pbs
pbs_3 = PythonScript(brp=data, pln=xy)  # -> flatten(pieces); inputs brp: Brep, pln: list of Plane; same code as pbs
tower_2 = Brep(tower)
number_slider_2 = Slider(4, range=0..5)
range_3 = Range(Domain=Domain(0, 1), Steps=window_amount_2)
data_2 = Data(pbs_2)
item = ListItem(List=debrep.Edges, Index=0, Wrap=True)  # -> Item1, Item
split_5 = SplitList(List=range_3, Index=Slider(1, range=0..1))  # -> ListA, ListB
debrep_2 = DeconstructBrep(Brep=data_2)  # -> Faces, Edges, Vertices
item_2 = ListItem(List=debrep_2.Faces, Index=number_slider_2, Wrap=True)
eval_3 = EvaluateCurve(Curve=reparameterize(item.Item1), Parameter=split_5.ListB)  # -> reverse(Point), Tangent, Angle
eval_4 = EvaluateCurve(Curve=reparameterize(item.Item), Parameter=split_5.ListB)  # -> Point, Tangent, Angle
debrep_3 = DeconstructBrep(Brep=item_2)  # -> Faces, Edges, Vertices
shift = ShiftList(List=eval_4.Point, Shift=framing_shift_2, Wrap=True)
item_3 = ListItem(List=debrep_3.Edges, Index=number_slider_2, Wrap=True)
elevators = Data(pbs_3)
floors = Brep(item_2)
glass = Brep(debrep.Faces)
ln_2 = Line(StartPoint=eval_3.Point, EndPoint=shift)
pipe = Pipe(Curve=item_3, Radius=framing_thickness_2, Caps=0)  # -> flatten(Pipe)
eval_5 = EvaluateCurve(Curve=ln_2, Parameter=Slider(0.5, range=0..1))  # -> Point, Tangent, Angle
area = Area(Geometry=cyl_3)  # -> Area, Centroid
vec2pt_2 = Vector2Pt(PointA=area.Centroid, PointB=eval_5.Point, Unitize=False)  # -> Vector, Length
project = Project(Curve=ln_2, Brep=debrep.Faces, Direction=vec2pt_2.Vector)
pipe_2 = Pipe(Curve=project, Radius=framing_thickness_2, Caps=0)  # -> flatten(Pipe)
merge_3 = Merge(Data1=pipe_2, Data2=pipe)
facade = Brep(merge_3)
