# Grasshopper definition SimplifiedWaterTower.gh (Grasshopper 0.9.76)

level_thickness = Slider(2, range=0..5)
tower_height = Slider(180, range=0..300)
leaf_amount = Slider(6, range=1..7)
stem_radius = Slider(7.4, range=1..20)
randomise_angle = BooleanToggle(True)
leaf_angle = Slider(3.166, range=0..6.283)
tower_base = Point(Point(-43.28271552, 46.3226775, 0))
simple_water_tower = SimpleWaterTower(
    tower_base=tower_base,
    level_thickness=level_thickness,
    tower_height=tower_height,
    leaf_angle=leaf_angle,
    stem_radius=stem_radius,
    randomised_angles=randomise_angle,
    leaf_amount=leaf_amount)
tower = Brep(simple_water_tower)

# ==== cluster SimpleWaterTower
level_thickness = ClusterInput()
tower_base = ClusterInput()
randomised_angles = ClusterInput()
stem_radius = ClusterInput()
tower_height = ClusterInput()
leaf_angle = ClusterInput()
leaf_amount = ClusterInput()
level_thickness_2 = Data(level_thickness)
tower_base_2 = Point(tower_base)
randomised_angles_2 = Boolean(randomised_angles)
stem_radius_2 = Data(stem_radius)
tower_height_2 = Data(tower_height)
leaf_angle_2 = Data(leaf_angle)
leaf_amount_2 = Data(leaf_amount)
Z = UnitZ(Factor=tower_height_2)
avr = Average(Input=leaf_angle_2)
range = Range(Domain=Domain(0.1, 1), Steps=expr("x+1", leaf_amount_2))
move = Move(Geometry=tower_base_2, Motion=Z)  # -> Geometry, Transform
leaf_base_point = Point(Point(3.896008657, -18.35570401, 0))
random = Random(Range=Domain(0, 6.283), Number=leaf_amount_2, Seed=avr)
crv = Curve(<curve referenced from the Rhino model>)
ln = Line(StartPoint=tower_base_2, EndPoint=move.Geometry)
multiplication = Multiplication(A=random, B=randomised_angles_2)
cyl = Cylinder(Base=tower_base_2, Radius=stem_radius_2, Length=tower_height_2)
split = SplitList(List=range, Index=Slider(1, range=0..1))  # -> ListA, ListB
addition = Addition(A=leaf_angle_2, B=multiplication)
split_2 = SplitList(List=split.ListB, Index=leaf_amount_2)  # -> ListA, ListB
rotate = Rotate(Geometry=crv, Angle=addition, Plane=leaf_base_point)  # -> Geometry, Transform
cap = CapHoles(Brep=cyl)
eval = EvaluateCurve(Curve=ln, Parameter=split_2.ListA)  # -> Point, Tangent, Angle
vec2pt = Vector2Pt(PointA=leaf_base_point, PointB=eval.Point, Unitize=False)  # -> Vector, Length
move_2 = Move(Geometry=rotate.Geometry, Motion=vec2pt.Vector)  # -> Geometry, Transform
Z_2 = UnitZ(Factor=level_thickness_2)
boundary = BoundarySurfaces(Edges=move_2.Geometry)
extr = Extrude(Base=boundary, Direction=Z_2)
merge = Merge(Data1=extr, Data2=cap)
tower = Brep(merge)
tower_2 = ClusterOutput(tower)
